# Grasshopper definition 00_anatomy_of_code_hs24_r8.gh (Grasshopper 1.0.8)
# plug-ins: RhinoCodePluginGH

# ----
# Anatomy of code
ironpython_2_script = IronPython2Script()  # -> out, a
# ---------- ironpython_2_script: IronPython ----------
# -----------------------------------
# ------------ Comments -------------

# Single line comments start with a hash.

"""
This is a multi-line comment.
It can span multiple lines.
Ideal for longer descriptions.
"""

# -----------------------------------
# ----------- Data Types ------------

# Integer: Whole numbers without a decimal point.
integer_example = 42

# Float: Numbers that include a decimal point.
float_example = 4.2429

# String: A sequence of characters in either single or double quotes.
string_example = "42"
string_example_2 = "Hello World"

# Boolean: Represents two values: True or False.
boolean_example = True



# ------------------------------------
# ----------- Expressions ------------

# Expression: A combination of values, variables, operators
# and functions that create a new value. 

# A value alone is itself a valid expression.
3.14

# This expression multiples two values with the * operator.
42 * 10                       # but we are not using the result!

# Expressions work similarly to math, e.g. parentheses to group parts
(42 * 10) / 2.5

# We can also combine with variables
integer_example / 2         # Divide the value of integer_example by 2

# -------------------------------------
# ------- Assignment Statements -------

# An assignment statement is an instruction that stores a value in a variable.

a = 10                        # Assigns the integer 10 to variable named a

# Assigning the result of an expression to a variable
b = a * 2                     # Multiplies a by 2 and stores the result in b

# -------------------------------------
# ------------ Statements -------------

# More generally, statements are instructions (usually a single line)
# that Python can execute and they cause a side effect. 

# A sequence of 3 statements to: assign a variable, print it and print its double
x = 42
print(x)
print(x * 2)



# -------------------------------------
# ------ Control Flow Statements ------

# Conditional (if) statement
if b > 10:
    print("b is greater than 10")

# A loop of a fixed number of iterations
for i in range(5):
    print(i)                   # Prints numbers 0 to 4

# A loop that iterates while a specified condition is true
# WARNING: always ensure the condition will eventually be false, otherwise, Grasshopper will freeze!
count = 0
while count < 5:
    print(count)
    count += 1                # Prints numbers 0 to 4, incrementing count each time

# ----------------------------
# --------- Functions --------

# Using one of many built-in functions in Python
largest_value = max(20, 5, 133)

# Some functions need to be "imported" first
# The imports are usually done at the beginning of the script
from math import sqrt
sqrt_example = sqrt(64)       # Calculates the square root of 64

# We can also define our own functions!
# Defining a simple function with two parameters
def add_numbers(x, y):
    return x + y              # Returns the sum of x and y

# Calling a function
result = add_numbers(5, 3)
print(result)                 # Prints 8





# ----------------------------
# ------ An algorithm! -------
def abs(value):              # function (aka definition)
    if value < 0:            # .. wraps an algorithm in a 
        return value * -1    # .. reusable building block
    else:
        return value

print(abs(-222))
# ---------- end ironpython_2_script ----------
