# Grasshopper definition 02-3d-grids-and-filters_hs24_r8.gh (Grasshopper 1.0.8)
# plug-ins: RhinoCodePluginGH

# ----
# Working with geometric types
# Minimal Box Constructor
size = Slider(6, range=0..10)
ironpython_2_script = IronPython2Script(size=size)  # -> box
# ---------- ironpython_2_script: IronPython ----------
from compas.geometry import Box

# Create a box with matching x, y and z sizes based on a single value
box = Box(size)
print(box.xsize)
print(box.ysize)
print(box.zsize)
# ---------- end ironpython_2_script ----------
ironpython_2_script_2 = IronPython2Script(cg=ironpython_2_script)  # -> rg
# ---------- ironpython_2_script_2: IronPython ----------
"""
Draws COMPAS geometry in Grasshopper.
"""

from ghpythonlib.componentbase import executingcomponent as component

from compas.scene import SceneObject


class CompasToRhinoGeometry(component):
    def RunScript(self, cg):
        if not cg:
            return None

        return SceneObject(item=cg).draw()
# ---------- end ironpython_2_script_2 ----------

# ----
# Constructors
ysize = Slider(5, range=0..10)
zsize = Slider(2, range=0..10)

# ----
# Basic Box Constructor
xsize = Slider(4, range=0..10)
pt = Point(Point(20, 0, 0))
ironpython_2_script_3 = IronPython2Script(center=pt, xsize=xsize, ysize=ysize, zsize=zsize)  # -> box; inputs center: Point3d, xsize: Int32, ysize: Int32
# ---------- ironpython_2_script_3: IronPython ----------
from compas.geometry import Box

# Create a box with custom dimensions
box = Box(xsize, ysize, zsize)

# Assign the center of its frame
box.frame.point = center
# ---------- end ironpython_2_script_3 ----------
ironpython_2_script_4 = IronPython2Script(cg=ironpython_2_script_3)  # -> rg; same code as ironpython_2_script_2

# ----
# Box.from_width_height_depth
width = Slider(4, range=0..10)
height = Slider(5, range=0..10)
depth = Slider(2, range=0..10)
pt_2 = Point(Point(40, 0, 0))
ironpython_2_script_5 = IronPython2Script(center=pt_2, width=width, height=height, depth=depth)  # -> box; inputs center: Point3d, width: Int32, height: Int32
# ---------- ironpython_2_script_5: IronPython ----------
from compas.geometry import Box

# Create a box from width, height, and depth
box = Box.from_width_height_depth(width, height, depth)

# Assign the center of its frame
box.frame.point = center
# ---------- end ironpython_2_script_5 ----------
ironpython_2_script_6 = IronPython2Script(cg=ironpython_2_script_5)  # -> rg; same code as ironpython_2_script_2

# ----
# Box.from_corner_corner_height
height_2 = Slider(6, range=0..10)
pt_3 = Point(Point(60, 0, 0))
pt_4 = Point(Point(66, 4.31834208, 0))
ironpython_2_script_7 = IronPython2Script(corner1=pt_3, corner2=pt_4, height=height_2)  # -> box; inputs corner1: Point3d, corner2: Point3d, height: Int32
# ---------- ironpython_2_script_7: IronPython ----------
# -----------------------------------------
# ------ Box from Corner and Height -------

from compas.geometry import Point, Box

# Create a box from opposite corners of its base and its height

"""
# You can always hard-code your parameters

corner1 = Point(0, 0, 0)
corner2 = Point(1, 1, 0)
height = 2
"""


box = Box.from_corner_corner_height(corner1, corner2, height)

print(box.xsize)  # Output: 1.0
print(box.ysize)  # Output: 1.0
print(box.zsize)  # Output: 2.0
# ---------- end ironpython_2_script_7 ----------
ironpython_2_script_8 = IronPython2Script(cg=ironpython_2_script_7)  # -> rg; same code as ironpython_2_script_2

# ----
# Oriented box
pt_5 = Point(Point(0, -20, 0))
xsize_2 = Slider(4, range=0..10)
ysize_2 = Slider(5, range=0..10)
zsize_2 = Slider(2, range=0..10)
ironpython_2_script_9 = IronPython2Script(center=pt_5, xaxis=".5,.5,0", yaxis="0,.5,.5", xsize=xsize_2, ysize=ysize_2, zsize=zsize_2)  # -> box; inputs center: Point3d, xaxis: Vector3d, yaxis: Vector3d
# ---------- ironpython_2_script_9: IronPython ----------
from compas.geometry import Box
from compas.geometry import Frame

frame = Frame(center, xaxis, yaxis)

# Create a box from width, height, and depth
box = Box(xsize, ysize, zsize, frame)
# ---------- end ironpython_2_script_9 ----------
ironpython_2_script_10 = IronPython2Script(cg=ironpython_2_script_9)  # -> rg; same code as ironpython_2_script_2

# ----
# Attributes
ghpython_script = GhPythonScript(box=ironpython_2_script_9)  # -> xsize, ysize, zsize, volume, area, xmin, xmax, ymin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
# ---------- ghpython_script: Python ----------
xsize = box.xsize
ysize = box.ysize
zsize = box.zsize
volume = box.volume
area = box.area
xmin = box.xmin
xmax = box.xmax
ymin = box.ymin
ymax = box.ymax
zmin = box.zmin
zmax = box.zmax
# ---------- end ghpython_script ----------
panel = Panel(ghpython_script.xsize)
panel_2 = Panel(ghpython_script.ysize)
panel_3 = Panel(ghpython_script.zsize)
panel_4 = Panel(ghpython_script.volume)
panel_5 = Panel(ghpython_script.area)
panel_6 = Panel(ghpython_script.xmin)
panel_7 = Panel(ghpython_script.xmax)
panel_8 = Panel(ghpython_script.ymin)
panel_9 = Panel(ghpython_script.ymax)
panel_10 = Panel(ghpython_script.zmin)
panel_11 = Panel(ghpython_script.zmax)

xsize_3 = Slider(4, range=0..10)
ysize_3 = Slider(6, range=0..10)
zsize_3 = Slider(6, range=0..10)
pt_6 = Point(Point(120, 0, 0))
ironpython_2_script_11 = IronPython2Script(center=pt_6, xsize=xsize_3, ysize=ysize_3, zsize=zsize_3)  # -> box; inputs center: Point3d, xsize: Int32, ysize: Int32; same code as ironpython_2_script_3
ironpython_2_script_12 = IronPython2Script(box=ironpython_2_script_11, angle=Slider(-1.74, range=-6.283..6.283), axis="0,0,1")  # -> a; inputs axis: Vector3d
# ---------- ironpython_2_script_12: IronPython ----------
from compas.geometry import Box

# First copy, then rotate the copy
a = box.copy()
a.rotate(angle, axis=axis, point=box.frame.point)
# ---------- end ironpython_2_script_12 ----------
ironpython_2_script_13 = IronPython2Script(cg=ironpython_2_script_12)  # -> rg; same code as ironpython_2_script_2

angle = Slider(0.104, range=-6.283..6.283)
pt_7 = Point(Point(100, 0, 0))
ironpython_2_script_14 = IronPython2Script(center=pt_7, angle=angle, axis="1,0,0")  # -> a; inputs center: Point3d, axis: Vector3d
# ---------- ironpython_2_script_14: IronPython ----------
from compas.geometry import Box

box = Box(3, 5, 4)
box.frame.point = center

# Rotate while creating a copy
a = box.rotated(angle, axis=axis, point=box.frame.point)
# ---------- end ironpython_2_script_14 ----------
ironpython_2_script_15 = IronPython2Script(cg=ironpython_2_script_14)  # -> rg; same code as ironpython_2_script_2

# ----
# 3D point grid, simple
number_slider = Slider(10, range=0..20)
nz = Slider(10, range=0..20)

center_of_grid = Point(Point(100, 20, 0))
# Mathematical Equations
nz_2 = Slider(10, range=0..20)
geometry = Geometry(<extrusion referenced from the Rhino model>)

# ----
# 3d grids
center_of_grid_2 = Point(Point(0, 20, 0))
ironpython_2_script_16 = IronPython2Script(center=center_of_grid_2, nx=Slider(10, range=0..20), ny=number_slider, nz=nz)  # -> a; inputs center: Point3d, nx: Int32, ny: Int32, nz: Int32
# ---------- ironpython_2_script_16: IronPython ----------
from compas.geometry import Point

a = []

for ix in range(nx):
    for iy in range(ny):
        for iz in range(nz):
            x = (center.X - nx / 2) + ix
            y = (center.Y - ny / 2) + iy
            z = (center.Z - nz / 2) + iz
            point = Point(x, y, z)
            a.append(point)
# ---------- end ironpython_2_script_16 ----------
ironpython_2_script_17 = IronPython2Script(cg=ironpython_2_script_16)  # -> rg; same code as ironpython_2_script_2

# ----
# 3D box grid, simple
number_slider_2 = Slider(10, range=0..20)
nz_3 = Slider(10, range=0..20)

center_of_grid_3 = Point(Point(20, 20, 0))
ironpython_2_script_18 = IronPython2Script(center=center_of_grid_3, nx=number_slider_2, ny=Slider(10, range=0..20), nz=nz_3)  # -> a; inputs center: Point3d, nx: Int32, ny: Int32, nz: Int32
# ---------- ironpython_2_script_18: IronPython ----------
from compas.geometry import Point, Box

a = []

for ix in range(nx):
    for iy in range(ny):
        for iz in range(nz):
            x = (center.X - nx / 2) + ix
            y = (center.Y - ny / 2) + iy
            z = (center.Z - nz / 2) + iz
            point = Point(x, y, z)
            box = Box(.9)
            box.frame.point = point
            a.append(box)
# ---------- end ironpython_2_script_18 ----------
ironpython_2_script_19 = IronPython2Script(cg=ironpython_2_script_18)  # -> rg; same code as ironpython_2_script_2

# ----
# 3D box grid with modulo filter
number_slider_3 = Slider(10, range=0..20)
nz_4 = Slider(10, range=0..20)

center_of_grid_4 = Point(Point(40, 20, 0))
ironpython_2_script_20 = IronPython2Script(center=center_of_grid_4, nx=number_slider_3, ny=Slider(10, range=0..20), nz=nz_4)  # -> a; inputs center: Point3d, nx: Int32, ny: Int32, nz: Int32
# ---------- ironpython_2_script_20: IronPython ----------
import math
from random import choice
from compas.geometry import Point, Box


def modulo_filter(x, y, z):
    result = (x + y + z) % 2 == 0
    return result
    
a = []

for ix in range(nx):
    for iy in range(ny):
        for iz in range(nz):
            if modulo_filter(ix, iy, iz):
                x = (center.X - nx / 2) + ix
                y = (center.Y - ny / 2) + iy
                z = (center.Z - nz / 2) + iz

                point = Point(x, y, z)
                box = Box(.9)
                box.frame.point = point
                a.append(box)
# ---------- end ironpython_2_script_20 ----------
ironpython_2_script_21 = IronPython2Script(cg=ironpython_2_script_20)  # -> rg; same code as ironpython_2_script_2

# ----
# 3D box grid with random filter
number_slider_4 = Slider(10, range=0..20)
# Geometric filters
nz_5 = Slider(10, range=0..20)

center_of_grid_5 = Point(Point(60, 20, 0))
ironpython_2_script_22 = IronPython2Script(center=center_of_grid_5, nx=number_slider_4, ny=Slider(10, range=0..20), nz=nz_5)  # -> a; inputs center: Point3d, nx: Int32, ny: Int32, nz: Int32
# ---------- ironpython_2_script_22: IronPython ----------
from random import choice
from compas.geometry import Point, Box


def random_filter():
    result = choice([True, False])
    return result

a = []

for ix in range(nx):
    for iy in range(ny):
        for iz in range(nz):
            if random_filter():
                x = (center.X - nx / 2) + ix
                y = (center.Y - ny / 2) + iy
                z = (center.Z - nz / 2) + iz
                point = Point(x, y, z)
                box = Box(.9)
                box.frame.point = point
                a.append(box)
# ---------- end ironpython_2_script_22 ----------
ironpython_2_script_23 = IronPython2Script(cg=ironpython_2_script_22)  # -> rg; same code as ironpython_2_script_2

# ----
# 3D box grid with sphere filter
number_slider_5 = Slider(10, range=0..20)
nz_6 = Slider(10, range=0..20)

center_of_grid_6 = Point(Point(80, 20, 0))
radius = Slider(2, range=0..20)
ironpython_2_script_24 = IronPython2Script(center=center_of_grid_6, nx=number_slider_5, ny=Slider(10, range=0..20), nz=nz_6, radius=radius)  # -> a; inputs center: Point3d, nx: Int32, ny: Int32, nz: Int32
# ---------- ironpython_2_script_24: IronPython ----------
import math
from compas.geometry import Point, Box

def sphere_distance_filter(x, y, z, center, radius):
    distance = math.sqrt((center.X - x)**2 + (center.Y - y)**2 + (center.Z - z)**2)
    return radius >= distance

a = []

for ix in range(nx):
    for iy in range(ny):
        for iz in range(nz):
            x = (center.X - nx / 2) + ix
            y = (center.Y - ny / 2) + iy 
            z = (center.Z - nz / 2) + iz
            if sphere_distance_filter(x, y, z, center, radius):
                point = Point(x, y, z)
                box = Box(.9)
                box.frame.point = point
                a.append(box)
# ---------- end ironpython_2_script_24 ----------
ironpython_2_script_25 = IronPython2Script(cg=ironpython_2_script_24)  # -> rg; same code as ironpython_2_script_2

# ----
# 3D point grid with linear filter
nz_7 = Slider(10, range=0..20)
coefficient = Slider(1, range=0..2)
center_of_grid_7 = Point(Point(120, 20, 0))

coefficient_2 = Slider(1, range=0..2)
threshold = Slider(12.32, range=0..100)
coefficient_3 = Slider(1, range=0..2)
ironpython_2_script_26 = IronPython2Script(
    center=center_of_grid_7,
    nx=Slider(10, range=0..20),
    ny=Slider(10, range=0..20),
    nz=nz_7,
    coefficient_x=coefficient,
    coefficient_y=coefficient_3,
    coefficient_z=coefficient_2,
    threshold=threshold)  # -> a; inputs center: Point3d, nx: Int32, ny: Int32, nz: Int32
# ---------- ironpython_2_script_26: IronPython ----------
import math
from compas.geometry import Point, Box

def linear_filter(x, y, z, coefficient_x, coefficient_y, coefficient_z, threshold):
    return coefficient_x*x + coefficient_y*y + coefficient_z*z < threshold

a = []

# Iterate over a 3D grid
for ix in range(nx):
    for iy in range(ny):
        for iz in range(nz):
            x = (center.X - nx / 2) + ix
            y = (center.Y - ny / 2) + iy 
            z = (center.Z - nz / 2) + iz
            if linear_filter(ix, iy, iz, coefficient_x, coefficient_y, coefficient_z, threshold):
                point = Point(x, y, z)
                box = Box(1)
                box.frame.point = point
                a.append(box)
# ---------- end ironpython_2_script_26 ----------
ironpython_2_script_27 = IronPython2Script(cg=ironpython_2_script_26)  # -> rg; same code as ironpython_2_script_2

# ----
# 3D point grid with linear filter (two planes)
horizontal_shift_y = Slider(0, range=-20..20)
nz_8 = Slider(10, range=0..20)
coefficient_4 = Slider(1.6, range=0..2)
center_of_grid_8 = Point(Point(140, 20, 0))

# ----
# 3D point grid with paraboloid filter
vertical_shift_y = Slider(-4, range=-20..20)
vertical_shift_x = Slider(-4, range=-20..20)
nz_9 = Slider(10, range=0..20)
coefficient_5 = Slider(0.25, range=0..5)
center_of_grid_9 = Point(Point(160, 20, 0))

horizontal_shift_x = Slider(1, range=-20..20)
horizontal_shift_y_2 = Slider(1, range=-20..20)
ironpython_2_script_28 = IronPython2Script(
    center=center_of_grid_9,
    nx=Slider(10, range=0..20),
    ny=Slider(10, range=0..20),
    nz=nz_9,
    coefficient=coefficient_5,
    vertical_shift_x=vertical_shift_x,
    vertical_shift_y=vertical_shift_y,
    horizontal_shift_x=horizontal_shift_x,
    horizontal_shift_y=horizontal_shift_y_2)  # -> a; inputs center: Point3d, nx: Int32, ny: Int32, nz: Int32
# ---------- ironpython_2_script_28: IronPython ----------
import math
from compas.geometry import Point, Box

# Paraboloid filter function
def paraboloid_filter(x, y, z, coefficient, horizontal_shift_x, horizontal_shift_y, vertical_shift_x, vertical_shift_y):
    z_paraboloid_x = (coefficient * ((x + vertical_shift_x) ** 2 + (y + vertical_shift_y) ** 2)) + horizontal_shift_x
    z_paraboloid_y = (coefficient * ((y + vertical_shift_x) ** 2 + (x + vertical_shift_x) ** 2)) + horizontal_shift_y

    # Check if the z value of the point is less than or equal to the z value of the paraboloid
    return z_paraboloid_x > z < z_paraboloid_y


a = []

# Iterate over a 3D grid
for ix in range(nx):
    for iy in range(ny):
        for iz in range(nz):
            x = (center.X - nx / 2) + ix
            y = (center.Y - ny / 2) + iy 
            z = (center.Z - nz / 2) + iz
            # Apply the paraboloid filter
            if paraboloid_filter(ix, iy, iz, coefficient, horizontal_shift_x, horizontal_shift_y, vertical_shift_x, vertical_shift_y):
                point = Point(x, y, z)
                box = Box(1)
                box.frame.point = point
                a.append(box)
# ---------- end ironpython_2_script_28 ----------
ironpython_2_script_29 = IronPython2Script(cg=ironpython_2_script_28)  # -> rg; same code as ironpython_2_script_2

# ----
# 3D box grid with referenced geometry
ironpython_2_script_30 = IronPython2Script(center=center_of_grid, nx=Slider(10, range=0..20), ny=Slider(10, range=0..20), nz=nz_2, rhino_box=geometry)  # -> a; inputs center: Point3d, nx: Int32, ny: Int32, nz: Int32, rhino_box: Box
# ---------- ironpython_2_script_30: IronPython ----------
import math
from compas.geometry import Point, Box, Sphere
from compas_rhino.conversions import box_to_compas

if rhino_box:
    filter_box = box_to_compas(rhino_box)
    print(rhino_box.Plane)
    a = []

    for ix in range(nx):
        for iy in range(ny):
            for iz in range(nz):
                x = (center.X - nx / 2) + ix
                y = (center.Y - ny / 2) + iy 
                z = (center.Z - nz / 2) + iz
                if filter_box.contains_point((x, y, z)):
                    point = Point(x, y, z)
                    box = Box(.9)
                    box.frame.point = point
                    a.append(box)
# ---------- end ironpython_2_script_30 ----------
ironpython_2_script_31 = IronPython2Script(cg=ironpython_2_script_30)  # -> rg; same code as ironpython_2_script_2

ironpython_2_script_32 = IronPython2Script(
    center=center_of_grid_8,
    nx=Slider(10, range=0..20),
    ny=Slider(10, range=0..20),
    nz=nz_8,
    coefficient=coefficient_4,
    vertical_shift_x=Slider(0, range=-20..20),
    vertical_shift_y=Slider(0, range=-20..20),
    horizontal_shift_x=Slider(0, range=-20..20),
    horizontal_shift_y=horizontal_shift_y)  # -> a; inputs center: Point3d, nx: Int32, ny: Int32, nz: Int32
# ---------- ironpython_2_script_32: IronPython ----------
import math
from compas.geometry import Point, Box

# Linear filter function
def linear_filter(x, y, z, coefficient=1, vertical_shift_x=0, vertical_shift_y=0, horizontal_shift_x=0, horizontal_shift_y=0):
    z_range_x = (coefficient * x + vertical_shift_x) + horizontal_shift_x
    z_range_y = (coefficient * y + vertical_shift_y) + horizontal_shift_y
    
    return z < z_range_x or z < z_range_y  

a = []

# Iterate over a 3D grid
for ix in range(nx):
    for iy in range(ny):
        for iz in range(nz):
            x = (center.X - nx / 2) + ix
            y = (center.Y - ny / 2) + iy 
            z = (center.Z - nz / 2) + iz
            # Apply the linear filter
            if linear_filter(ix, iy, iz, coefficient, vertical_shift_x, vertical_shift_y, horizontal_shift_x, horizontal_shift_y):
                point = Point(x, y, z)
                box = Box(1)
                box.frame.point = point
                a.append(box)
# ---------- end ironpython_2_script_32 ----------
ironpython_2_script_33 = IronPython2Script(cg=ironpython_2_script_32)  # -> rg; same code as ironpython_2_script_2

# ----
# Exploration
# Helix
number_slider_6 = Slider(1.16, range=0..3)
center = Point(Point(0, 40, 0))
ironpython_2_script_34 = IronPython2Script(
    center=center,
    radius=number_slider_6,
    pitch=Slider(1.85, range=1..10),
    turns=Slider(14, range=10..50),
    num_segments=Slider(20, range=10..50))  # -> points, boxes; inputs center: Point3d, turns: Int32, num_segments: Int32
# ---------- ironpython_2_script_34: IronPython ----------
import math
from compas.geometry import Box
from compas.geometry import Frame
from compas.geometry import Point
from compas.geometry import Vector


# Generate helix points
points = []
tangents = []
total_segments = turns * num_segments

for i in range(total_segments):
    angle = 2 * math.pi * i / num_segments
    z = pitch * i / num_segments
    x1 = radius * math.cos(angle)
    y1 = radius * math.sin(angle)

    dx1 = -radius * math.sin(angle)
    dy1 = radius * math.cos(angle)
    dz = pitch / num_segments

    tangent1 = Vector(dx1, dy1, dz)
    tangent1.unitize()

    points.append(Point(x1 + center.X, y1 + center.Y, z + center.Z))
    tangents.append(tangent1)

# Create boxes
boxes = []
for point, xaxis in zip(points, tangents):
    zaxis = Vector(0, 0, 1)
    yaxis = zaxis.cross(xaxis) # Orthogonal vector for Y-axis
    yaxis.unitize()
    
    frame = Frame(point, xaxis, yaxis)
    
    # Create the box at the point with the specified frame
    box = Box(.2, .2, .2)
    box.frame = frame
    boxes.append(box)
# ---------- end ironpython_2_script_34 ----------
ironpython_2_script_35 = IronPython2Script(cg=ironpython_2_script_34.boxes)  # -> rg; same code as ironpython_2_script_2

# ----
# Methods
size_2 = Slider(5, range=0..10)
pt_8 = Point(Point(80, 0, 0))
pt_9 = Point(Point(81.06491735, 0, 0))

ironpython_2_script_36 = IronPython2Script(center=pt_8, point=pt_9, size=size_2)  # -> out, box; inputs center: Point3d, point: Point3d
# ---------- ironpython_2_script_36: IronPython ----------
from compas.geometry import Box

box = Box(size)
box.frame.point = center

print(box.contains_point(point))
# ---------- end ironpython_2_script_36 ----------

panel_12 = Panel(ironpython_2_script_36.out)

ironpython_2_script_37 = IronPython2Script(cg=ironpython_2_script_36.box)  # -> rg; same code as ironpython_2_script_2

xsize_4 = Slider(4, range=0..10)
ysize_4 = Slider(6, range=0..10)
zsize_4 = Slider(6, range=0..10)
pt_10 = Point(Point(140, 0, 0))

ironpython_2_script_38 = IronPython2Script(center=pt_10, xsize=xsize_4, ysize=ysize_4, zsize=zsize_4)  # -> box; inputs center: Point3d, xsize: Int32, ysize: Int32; same code as ironpython_2_script_3

ironpython_2_script_39 = IronPython2Script(box=ironpython_2_script_38, factor=Slider(1.313, range=0..5))  # -> a
# ---------- ironpython_2_script_39: IronPython ----------
from compas.geometry import Box

# First copy, then rotate the copy
a = box.copy()
a.scale(factor)
# ---------- end ironpython_2_script_39 ----------
ironpython_2_script_40 = IronPython2Script(cg=ironpython_2_script_39)  # -> rg; same code as ironpython_2_script_2

xsize_5 = Slider(4, range=0..10)
ysize_5 = Slider(6, range=0..10)
zsize_5 = Slider(6, range=0..10)
pt_11 = Point(Point(160, 0, 0))

ironpython_2_script_41 = IronPython2Script(center=pt_11, xsize=xsize_5, ysize=ysize_5, zsize=zsize_5)  # -> box; inputs center: Point3d, xsize: Int32, ysize: Int32; same code as ironpython_2_script_3

ironpython_2_script_42 = IronPython2Script(
    box=ironpython_2_script_41,
    xmove=Slider(1.62, range=-10..10),
    ymove=Slider(-4.79, range=-10..10),
    zmove=Slider(3.685, range=-10..10))  # -> a
# ---------- ironpython_2_script_42: IronPython ----------
from compas.geometry import Box
from compas.geometry import Translation

# First copy, then transform the copy with a translation
a = box.copy()
motion_vector = (xmove, ymove, zmove)
a.transform(Translation.from_vector(motion_vector))
# ---------- end ironpython_2_script_42 ----------
ironpython_2_script_43 = IronPython2Script(cg=ironpython_2_script_42)  # -> rg; same code as ironpython_2_script_2
